# Grasshopper definition rnd_node.gh (Grasshopper 1.0.7)
# plug-ins: PTComponentLibrary, Heteroptera, Pufferfish

# ---- group: RH_IN:radius
radius = Slider(20, range=5..20)

# ---- group: RH_IN:height
height = Slider(11, range=2..20)

# ----
circle = Circle(Plane=PlaneXY(0, 0, 0), Radius=radius)
unit_z = UnitZ(Factor=height)
extrude = Extrude(Base=circle, Direction=unit_z)
cap_holes = CapHoles(Brep=extrude)
area = Area(Geometry=cap_holes)  # -> Area, Centroid
deconstruct_brep = DeconstructBrep(Brep=cap_holes)  # -> Faces, Edges, Vertices
list_item = ListItem(List=deconstruct_brep.Faces, Index=0, Wrap=True)  # -> Item, Item1
scale = Scale(Geometry=cap_holes, Center=area.Centroid, Factor=Slider(0.75, range=0..1))  # -> Geometry, Transform
unit_z_2 = UnitZ(Factor=1)
populate_3d = Populate3D(Region=cap_holes, Count=100, Seed=1)
extrude_2 = Extrude(Base=list_item.Item1, Direction=unit_z_2)
voronoi_3d = Voronoi3D(Points=populate_3d)  # -> Cells, Boundary
point_in_brep = PointInBrep(Brep=scale.Geometry, Point=populate_3d, Strict=False)
dispatch = Dispatch(List=voronoi_3d.Cells, DispatchPattern=point_in_brep)  # -> ListA, ListB
brep = Brep(dispatch.ListA)
deconstruct_brep_2 = DeconstructBrep(Brep=brep)  # -> Faces, Edges, Vertices
deconstruct_brep_3 = DeconstructBrep(Brep=deconstruct_brep_2.Faces)  # -> Faces, Edges, Vertices
area_2 = Area(Geometry=deconstruct_brep_3.Faces)  # -> Area, Centroid
factor = Slider(0.9, range=0..1)
scale_2 = Scale(Geometry=deconstruct_brep_3.Faces, Center=area_2.Centroid, Factor=factor)  # -> Geometry, Transform
xy_plane = XYPlane(Origin=Point(0, 0, 0))
unit_x = UnitX(Factor=Slider(68, range=0..100))
deconstruct_brep_4 = DeconstructBrep(Brep=scale_2.Geometry)  # -> Faces, Edges, Vertices
number_slider = Slider(45, range=0..100)
move = Move(Geometry=xy_plane, Motion=unit_x)  # -> Geometry, Transform
join_curves = JoinCurves(Curves=deconstruct_brep_4.Edges, Preserve=False)  # -> simplify(Curves)
construct_domain = ConstructDomain(DomainStart=expr("-x", number_slider), DomainEnd=number_slider)
number_slider_2 = Slider(5, range=0..10)
join_curves_2 = JoinCurves(Curves=deconstruct_brep_3.Edges, Preserve=False)  # -> simplify(Curves)
rectangle = Rectangle(Plane=move.Geometry, XSize=construct_domain, YSize=construct_domain, Radius=0)  # -> Rectangle, Length
divide_surface = DivideSurface(Surface=rectangle.Rectangle, UCount=number_slider_2, VCount=number_slider_2)  # -> Points, Normals, Parameters
loft = Loft(
    Curves=[join_curves_2, join_curves],
    Options={Adjust=False, Closed=False, LoftEnds=0, LoftSimp=0, LoftType=0, Rebuild=10, Refit=0.01})
path_mapper = PathMapper(loft, source="{A;B}(i)", target="{A}(B+i)")
cellulate = Cellulate(Grid=divide_surface.Points)  # -> Wires, Cells, Meshes
panel = Panel(path_mapper)
area_3 = Area(Geometry=cellulate.Meshes)  # -> Area, flatten(Centroid)
flip_matrix = FlipMatrix(Data=path_mapper)
center = Center(Geometry=path_mapper, forall=True)  # -> flatten(Center), Dimension
list_length = ListLength(List=flatten(center.Center))
series = Series(Start=0, Step=1, Count=list_length)
list_item_2 = ListItem(List=flip_matrix, Index=0, Wrap=True)
list_item_3 = ListItem(List=area_3.Centroid, Index=series, Wrap=True)
custom_preview = CustomPreview(
    Geometry=list_item_2,
    Material={diffuse=RGB(221, 160, 221), emission=RGB(66, 48, 66), shine=0.5, specular=RGB(255, 255, 255), transparency=0})
move_to_point = MoveToPoint(Geometry=path_mapper, PointA=graft(center.Center), PointB=graft(list_item_3))  # -> Moved, Vector, Transform
list_item_4 = ListItem(List=list_item_3, Index=0, Wrap=True)
circle_2 = Circle(Plane=list_item_4, Radius=Slider(8, range=0..10))
pipe = Pipe(Curve=circle_2, Radius=Slider(0.4, range=0..1), Caps=0)
