# Grasshopper definition rnd_node_basic.gh (Grasshopper 1.0.7)

# ---- group: RH_IN:radius
radius = Slider(20, range=5..20)

# ---- group: RH_IN:height
height = Slider(9, range=2..20)

# ----
circle = Circle(Plane=PlaneXY(0, 0, 0), Radius=radius)
unit_z = UnitZ(Factor=height)
extrude = Extrude(Base=circle, Direction=unit_z)
cap_holes = CapHoles(Brep=extrude)
area = Area(Geometry=cap_holes)  # -> Area, Centroid
deconstruct_brep = DeconstructBrep(Brep=cap_holes)  # -> Faces, Edges, Vertices
list_item = ListItem(List=deconstruct_brep.Faces, Index=0, Wrap=True)  # -> Item, Item1
scale = Scale(Geometry=cap_holes, Center=area.Centroid, Factor=Slider(0.75, range=0..1))  # -> Geometry, Transform
unit_z_2 = UnitZ(Factor=1)
populate_3d = Populate3D(Region=cap_holes, Count=100, Seed=1)
extrude_2 = Extrude(Base=list_item.Item1, Direction=unit_z_2)
voronoi_3d = Voronoi3D(Points=populate_3d)  # -> Cells, Boundary
point_in_brep = PointInBrep(Brep=scale.Geometry, Point=populate_3d, Strict=False)
dispatch = Dispatch(List=voronoi_3d.Cells, DispatchPattern=point_in_brep)  # -> ListA, ListB
brep = Brep(dispatch.ListA)
